# Grasshopper definition Combined.gh (Grasshopper 0.9.76)
# plug-ins: Badger

panel = Panel("Flows")
panel_2 = Panel("Plants")
panel_3 = Panel("Floods")
panel_4 = Panel("Fields")

manual_points = Point([<point referenced from the Rhino model> x12])
file = ReadFile(File="C:\Users\Philip\Documents\badger\Examples\Combined.csv", PerLineParse=True)
years = Slider(30, range=0..100)
crv = Curve(<curve referenced from the Rhino model>)
pimport = SpeciesAttributeImporter(CSVFile=file)
boundary = BoundarySurfaces(Edges=crv)
generic_species = GenericSpeciesAttributes()  # -> ShrubP, GrassP, TreeP
placer = PlantPlacementSolver(Plants=pimport, Area=boundary)  # -> Plants, Locations
placer_2 = PlantPlacementSolver(Plants=generic_species.ShrubP, Area=boundary)  # -> Plants, Locations
shower = PlantAppearanceSimulator(Plants=pimport, Locations=manual_points, Time=years)  # -> Trunk, Root, Crown, Spacing, Color, Label
circle = Circle(shower.Trunk)
circle_2 = Circle(shower.Crown)
circle_3 = Circle(shower.Root)
circle_4 = Circle(shower.Spacing)
tag = TextTag3D(Location=manual_points, Text=shower.Label, Size=Slider(141, range=0..1000), Colour=shower.Color, Justification=7)

grid_rectangle = Curve(<curve referenced from the Rhino model>)
grid_divisions = Integer(Slider(10, range=0..10))
file_2 = ReadFile(F="C:\Users\s3321811\Dropbox\PhD Work\0 Code\field-tests\Cartography\Field Visualisers\Fields.py", PerLineParse=False)  # -> C
#   port F: Uri of file to read
# ---------- file_2: VB line parser ----------
    action = GH_LineParserAction.Include
    Return line

    'Parse the line and return some data that represents the line.
    'If the line cannot be parsed, you can return Nothing and
    'assign a different action.
    'The default implementation is to just return the line itself.
    'If you return types that implement IGH_Goo, this component
    'will work substantially faster.
# ---------- end file_2 ----------
regions = Curve([<curve referenced from the Rhino model> x4])
debug = Boolean(True)
num = Number()

srf = Surface(<surface referenced from the Rhino model>)
sdivide = DivideSurface(Surface=srf, UCount=Slider(7, range=0..10), VCount=Slider(30, range=0..100))  # -> flatten(Points), Normals, Parameters
flows = FlowSimulation(Surface=srf, Points=sdivide.Points, Fidelity=Slider(50, range=0..100))  # -> C, P
crv_2 = Curve(flows.C)
preview = CustomPreview(Geometry=crv_2, Shader=ColourSwatch(SwatchColor=RGB(0, 195, 255)))

c_script = CSharpScript(Bounds=grid_rectangle, Divisions=grid_divisions, Regions=regions)  # -> Out, Field

colour = ColourPicker(PickedColour=RGBA(255, 0, 255, 106))
colour_2 = ColourPicker(PickedColour=RGBA(0, 255, 255, 105))
colour_3 = ColourPicker(PickedColour=RGBA(0, 119, 255, 107))
panel_5 = Panel("Colours")
colour_4 = ColourPicker(PickedColour=RGBA(67, 117, 255, 105))

coast = Curve(<curve referenced from the Rhino model>)
construct_point = ConstructPoint(XCoordinate=Slider(0, range=-100000..0), YCoordinate=Slider(0, range=-1000..10000), ZCoordinate=0)
number_slider = Slider(10000, range=0..100000)
panel_6 = Panel("Testing Area")
frontline = Curve(coast)
y_size = Number(number_slider)
x_size = Number(number_slider)
origin = Point(construct_point)

terrain = Brep(<brep referenced from the Rhino model>)

panel_7 = Panel("High Tide Data")
mean_high_water_springs = Slider(1000, range=0..5000)
mean_high_water_neaps = Slider(1450, range=0..5000)
mean_low_water_neaps = Slider(700, range=0..5000)
mean_low_water_springs = Slider(430, range=0..5000)
mean_sea_level = Slider(0, range=0..5000)

panel_8 = Panel("Site Data")
sea_level_rise_year = Slider(1.6, range=0..5)
storm_surge_height = Slider(500, range=0..5000)
sea_datum_z = Slider(0, range=-3000..3000)
year = Slider(2068, range=2015..2115)

terrain_2 = Brep(terrain)
frontline_2 = Curve(frontline)
terrain_3 = Brep(terrain_2)

origin_2 = Point(origin)
num_2 = Number(sea_datum_z)
x_size_2 = Number(x_size)
y_size_2 = Number(y_size)
num_3 = Number(year)
num_4 = Number(sea_level_rise_year)
num_5 = Number(mean_high_water_neaps)
num_6 = Number(mean_low_water_neaps)
num_7 = Number(mean_high_water_springs)
num_8 = Number(mean_low_water_springs)
num_9 = Number(mean_sea_level)
num_10 = Number(storm_surge_height)

floods = FloodSimulator(Datum=num_2, Year=num_3, Rise=num_4, Surge=num_10, HighNeap=num_5, LowNeap=num_6, HighSpring=num_7, LowSpring=num_8)  # -> SeaLevel, StormSurgeLevel, HighNeap, LowNeap, HighSpring, LowSpring

mean_high_water_spring = Geometry(floods.HighSpring)
mean_high_water_neap = Geometry(floods.HighNeap)
mean_low_water_spring = Geometry(floods.LowSpring)
mean_low_water_neap = Geometry(floods.LowNeap)
storm_surge_level = Geometry(floods.StormSurgeLevel)
mean_sea_level_2 = Geometry(floods.SeaLevel)

mean_high_water_spring_2 = Geometry(mean_high_water_spring)
mean_high_water_neap_2 = Geometry(mean_high_water_neap)
mean_low_water_spring_2 = Geometry(mean_low_water_spring)
mean_low_water_neap_2 = Geometry(mean_low_water_neap)
storm_surge_level_2 = Geometry(storm_surge_level)
mean_sea_level_3 = Geometry(mean_sea_level_2)
cluster = Cluster(level=mean_sea_level_3, frontline=frontline_2, terrain=terrain_3)  # -> curve_3, list
cluster_2 = Cluster(level=mean_low_water_neap_2, frontline=frontline_2, terrain=terrain_3)  # -> curve_3, list
cluster_3 = Cluster(level=storm_surge_level_2, frontline=frontline_2, terrain=terrain_3)  # -> curve_3, list
cluster_4 = Cluster(level=mean_high_water_neap_2, frontline=frontline_2, terrain=terrain_3)  # -> curve_3, list
cluster_5 = Cluster(level=mean_low_water_spring_2, frontline=frontline_2, terrain=terrain_3)  # -> curve_3, list
cluster_6 = Cluster(level=mean_high_water_spring_2, frontline=frontline_2, terrain=terrain_3)  # -> curve_3, list
mean_sea_level_srf = CustomPreview(Geometry=cluster.list, Shader=colour_3)
mean_sea_level_srf_2 = CustomPreview(Geometry=cluster_2.list, Shader=colour_3)
mean_sea_level_srf_3 = CustomPreview(Geometry=cluster_4.list, Shader=colour_3)
mean_sea_level_srf_4 = CustomPreview(Geometry=cluster_5.list, Shader=colour_3)
mean_sea_level_srf_5 = CustomPreview(Geometry=cluster_6.list, Shader=colour_3)
mean_sea_level_srf_6 = CustomPreview(Geometry=cluster_3.list, Shader=colour_3)
mean_sea_level_crv = CustomPreview(Geometry=cluster.curve_3, Shader=colour_3)
mean_sea_level_crv_2 = CustomPreview(Geometry=cluster_2.curve_3, Shader=colour_3)
mean_sea_level_crv_3 = CustomPreview(Geometry=cluster_4.curve_3, Shader=colour_3)
mean_sea_level_crv_4 = CustomPreview(Geometry=cluster_5.curve_3, Shader=colour_3)
mean_sea_level_crv_5 = CustomPreview(Geometry=cluster_6.curve_3, Shader=colour_3)
mean_sea_level_crv_6 = CustomPreview(Geometry=cluster_3.curve_3, Shader=colour_3)

# ==== cluster Cluster
level = ClusterInput()
frontline = ClusterInput()
terrain = ClusterInput()
level_2 = Brep(level)
terrain_2 = Brep(terrain)
bbx = BrepBrep(BrepA=terrain_2, BrepB=level_2)  # -> Curves, Points
find_closest = FindClosest(curve=bbx.Curves, curve_2=frontline)
split_with_brep = SplitWithBrep(Curve=level_2, Brep=terrain_2)  # -> Curve, Points
find_closest_2 = FindClosest(curve=split_with_brep.Curve, curve_2=frontline)
curve = Curve(find_closest)
list_item = ListItem(List=find_closest_2, Index=1, Wrap=True)
join_curves = JoinCurves(Curves=[curve, list_item], Preserve=False)
boundary_surfaces = BoundarySurfaces(Edges=join_curves)
list_length = ListLength(List=bbx.Curves)
larger_than = LargerThan(FirstNumber=list_length, SecondNumber=0)  # -> LargerThan, OrEqualTo
cull_pattern = CullPattern(List=boundary_surfaces, CullPattern=larger_than.LargerThan)
curve_2 = Curve(find_closest)
curve_3 = ClusterOutput(curve_2)
list = ClusterOutput(cull_pattern)

# ==== cluster FindClosest
curve = ClusterInput()
curve_2 = ClusterInput()
divide_curve = DivideCurve(Curve=curve_2, Count=2, Kinks=False)  # -> Points, Tangents, Parameters
divide_curve_2 = DivideCurve(Curve=curve, Count=2, Kinks=False)  # -> Points, Tangents, Parameters
list_item = ListItem(List=divide_curve_2.Points, Index=1, Wrap=True)  # -> flatten(Item)
list_item_2 = ListItem(List=divide_curve.Points, Index=1, Wrap=True)
distance = Distance(PointA=list_item, PointB=list_item_2)
sort_list = SortList(Keys=distance)  # -> Keys, ValuesValuesA
list_item_3 = ListItem(List=sort_list.Keys, Index=0, Wrap=True)
member_index = MemberIndex(Set=distance, Member=list_item_3)  # -> Index, Count
list_item_4 = ListItem(List=curve, Index=member_index.Index, Wrap=True)
i = ClusterOutput(list_item_4)
