# Grasshopper definition Groundhog - Flows Examples.ghx (Grasshopper 0.9.76)
# plug-ins: Groundhog

# ----
# Example 2 (Upper-Right)
proximity_threshold = Slider(100, range=0..100)
flow_step_size = Slider(25, range=0..100)
flow_step_limit = Slider(75, range=0..100)
random_points_count = Slider(150, range=0..1000)
multithread = BooleanToggle(True)

# ----
# Example 1 (Lower-Left)
number_slider = Slider(10, range=0..50)

# ---- group: Base Surface
# Groundhog Example File
# Definition prepared for Groundhog v0.10.2b and depends on components from that plugin. It is available for download at http://groundhog.la/
# 
# Contact groundhog@philipbelesky.com for support or feedback.
# 
# This is an example file related to the plugin's documentation.
# 
# This definition is licensed under the terms of the GPL v3 https://opensource.org/licenses/GPL-3.0
surface = Surface(<surface referenced from the Rhino model>)

# ---- group: Base Mesh
mesh = Mesh(<mesh referenced from the Rhino model>)

# ---- group: Create point grid for path starts
divide_surface = DivideSurface(Surface=surface, UCount=number_slider, VCount=Slider(10, range=0..50))  # -> flatten(Points), Normals, Parameters

# ---- group: Distribute points randomly on mesh for path starts
cluster = Cluster(C=mesh, N=random_points_count)

# ---- group: Calculate the flow paths (for mesh)
flow_projection_mesh = FlowSimulationMesh(Mesh=mesh, Points=cluster, Fidelity=flow_step_size, Steps=flow_step_limit, Thread=multithread)  # -> FlowPoints, FlowPaths

# ---- group: Calculate the flow paths (for surface)
flow_projection_surface = FlowProjectionSurface(Surface=surface, Points=divide_surface.Points, Fidelity=0, Steps=0, Thread=False)  # -> FlowPoints, FlowPaths

# ---- group: Calculate catchment bounds
flow_catchments = FlowCatchments(FlowPaths=flow_projection_surface.FlowPaths, ProximtyThreshold=Slider(25, range=0..100))  # -> Catchments, FlowPaths, ColorCodes

flow_catchments_2 = FlowCatchments(FlowPaths=flow_projection_mesh.FlowPaths, ProximtyThreshold=proximity_threshold)  # -> Catchments, FlowPaths, ColorCodes

# ---- group: Color flow paths by length from source
explode = Explode(Curve=flow_catchments.FlowPaths, Recursive=True)  # -> Segments, Vertices
luminance_step = Slider(-0.02, range=-1..0.1)
minimum_luminance = Slider(0, range=0..1)
list_length = ListLength(List=explode.Segments)
series = Series(Start=1, Step=luminance_step, Count=list_length)
maximum = Maximum(A=series, B=minimum_luminance)
colour_hsl = ColourHSL(Alpha=1, Hue=0.5, Saturation=1, Luminance=maximum)
custom_preview = CustomPreview(Geometry=explode.Segments, Shader=colour_hsl)

# ---- group: Color code catchment boundaries
custom_preview_2 = CustomPreview(Geometry=flow_catchments.Catchments, Shader=flow_catchments.ColorCodes)

# ---- group: Color code flow paths by catchment
custom_preview_3 = CustomPreview(Geometry=flow_catchments_2.FlowPaths, Shader=flow_catchments_2.ColorCodes)

# ---- group: Create and color a naïve flooding extents from end points
end_points = EndPoints(Curve=flow_projection_mesh.FlowPaths)  # -> Start, End
pooling_radius = Slider(1500, range=0..3000)
sampling_accuracy = Slider(10, range=0..1000)
pooling_color = ColourSwatch(SwatchColor=RGB(128, 132, 180))
deconstruct = Deconstruct(Point=end_points.End)  # -> XComponent, YComponent, ZComponent
construct_point = ConstructPoint(XCoordinate=deconstruct.XComponent, YCoordinate=deconstruct.YComponent, ZCoordinate=0)
list_length_2 = ListLength(List=construct_point)
repeat_data = RepeatData(Data=pooling_radius, Length=list_length_2)
metaball_t_custom = MetaBallTCustom(Points=construct_point, Charge=repeat_data, Plane=PlaneXY(0, 0, 0), Threshold=0.5, Accuracy=sampling_accuracy)

# ----
simplify_curve = SimplifyCurve(Curve=metaball_t_custom, Tolerance=5, AngleTolerance=1)  # -> Curve, Simplified

# ---- group: Create and color a naïve flooding extents from end points (continued)
boundary_surfaces = BoundarySurfaces(Edges=simplify_curve.Curve)
custom_preview_4 = CustomPreview(Geometry=boundary_surfaces, Shader=pooling_color)

# ==== cluster Cluster
N = ClusterInput()
C = ClusterInput()
bbox = BoundingBox(Content=C, Plane=PlaneXY(0, 0, 0))  # -> Box, Box_2
debrep = DeconstructBrep(Brep=bbox.Box)  # -> Faces, Edges, Vertices
item = ListItem(List=debrep.Faces, Index=Slider(5, range=0..10), Wrap=True)
pop2d = Populate2D(Region=item, Count=N, Seed=1)
volume = Volume(Geometry=bbox.Box)  # -> Volume, Centroid
area = Area(Geometry=item)  # -> Area, Centroid
vector_2pt = Vector2Pt(PointA=area.Centroid, PointB=volume.Centroid, Unitize=False)  # -> Vector, Length
deconstruct_vector = DeconstructVector(Vector=vector_2pt.Vector)  # -> XComponent, YComponent, ZComponent
unit_z = UnitZ(Factor=deconstruct_vector.ZComponent)
project = ProjectPoint(Point=pop2d, Direction=unit_z, Geometry=C)  # -> Point, Index
P = ClusterOutput(project.Point)
