# Grasshopper definition Groundhog - Terrain Examples.ghx (Grasshopper 0.9.76)
# plug-ins: Groundhog

# ---- group: Assume North = y axis (this is the default if not set)
unit_y = UnitY(Factor="1")

# ----
base_terrain_surface = Surface(<surface referenced from the Rhino model>)
base_terrain_surface_2 = Surface(<surface referenced from the Rhino model>)

base_terrain_mesh = Mesh(<mesh referenced from the Rhino model>)
aspect_angle = Vector(unit_y)

# ----
# Groundhog Example File
# Definition prepared for Groundhog v0.10.1b and depends on components from that plugin. It is available for download at http://groundhog.la/
# 
# Contact groundhog@philipbelesky.com for support or feedback.
# 
# This is an example .3dm file related to the plugin's documentation.
# 
# This definition is licensed under the terms of the GPL v3 https://opensource.org/licenses/GPL-3.0
base_terrain_mesh_2 = Mesh(<mesh referenced from the Rhino model>)

# ---- group: Calculate aspect from surface
surface_aspect = SurfaceAspect(Surface=base_terrain_surface_2, Aspect=Vector(0, 1, 0))  # -> MeshFaces, FaceCenters, FaceAspects

# ---- group: Calculate grade from surface
surface_slope = SurfaceSlope(Surface=base_terrain_surface)  # -> MeshFaces, FaceCenters, FaceVectors, FaceSlopes, FaceSlopes_2

# ---- group: Calculate aspect from mesh
mesh_aspect = MeshAspect(Mesh=base_terrain_mesh, Aspect=aspect_angle)  # -> MeshFaces, FaceCenters, FaceAspectAngles

# ---- group: Calculate grade from mesh
mesh_slope = MeshSlope(Mesh=base_terrain_mesh_2)  # -> MeshFaces, FaceCenters, FaceSlopeVectors, FaceSlopeAngles, FaceSlopes

# ---- group: Visualise grade on mesh faces
faces = Mesh(mesh_slope.MeshFaces)
angles = Integer(mesh_slope.FaceSlopeAngles)
bounds = Bounds(Numbers=angles)
gradient = Gradient(LowerLimit=0, UpperLimit=bounds, Parameter=angles, stops=[0: RGB(255, 255, 255), 1: RGB(0, 0, 0)])
mesh_colours = MeshColours(Mesh=simplify(graft(faces)), Colours=simplify(graft(gradient)))

# ---- group: Visualise grade direction
face_centers = Point(surface_slope.FaceCenters)
face_vectors = Vector(surface_slope.FaceVectors)
vector_length = Slider(0.608, range=0..2)
vector_color = ColourSwatch(SwatchColor=RGB(255, 255, 255))
multiplication = Multiplication(A=face_vectors, B=vector_length)
angles_vectors = VectorDisplayEx(Point=face_centers, Vector=multiplication, Colour=vector_color, Width=2)

# ---- group: Show face edges for reference
mesh_edges = MeshEdges(Mesh=surface_slope.MeshFaces)  # -> NakedEdges, InteriorEdges, NonManifoldEdges

# ---- group: Visualise aspect as solid gradient
faces_2 = Mesh(surface_aspect.MeshFaces)
angles_2 = Integer(surface_aspect.FaceAspects)
blur_iterations = Slider(0.6, range=0.2..2)
bounds_2 = Bounds(Numbers=angles_2)
gradient_2 = Gradient(
    LowerLimit=0,
    UpperLimit=bounds_2,
    Parameter=angles_2,
    stops=[0: RGB(255, 0, 0), 0.254: RGB(233, 136, 0), 0.5: RGB(254, 244, 84), 0.751: RGB(234, 126, 0), 1: RGB(255, 0, 0)])
mesh_colours_2 = MeshColours(Mesh=simplify(graft(faces_2)), Colours=simplify(graft(gradient_2)))
mesh_join = MeshJoin(Meshes=flatten(mesh_colours_2))
weld_mesh = WeldMesh(Mesh=mesh_join, Angle=3.141592654)
blur_mesh = BlurMesh(Mesh=weld_mesh, Iterations=blur_iterations)

# ---- group: Label aspects within specified range
face_centers_2 = Point(mesh_aspect.FaceCenters)
face_angles = Integer(mesh_aspect.FaceAspectAngles)
cutoff_b = Slider(120, range=0..360)
cutoff_a = Slider(180, range=0..360)
text_size = Slider(500, range=0..1000)
text_color = ColourSwatch(SwatchColor=RGB(0, 0, 0))
construct_domain = ConstructDomain(DomainStart=cutoff_b, DomainEnd=cutoff_a)
includes = Includes(Value=face_angles, Domain=construct_domain)  # -> Includes, Deviation
cull_pattern = CullPattern(List=face_centers_2, CullPattern=includes.Includes)
cull_pattern_2 = CullPattern(List=face_angles, CullPattern=includes.Includes)
angles_labels = TextTag3D(Location=cull_pattern, Text=cull_pattern_2, Size=text_size, Colour=text_color, Justification=5)

# ---- group: Show face edges for reference
mesh_edges_2 = MeshEdges(Mesh=mesh_aspect.MeshFaces)  # -> NakedEdges, InteriorEdges, NonManifoldEdges
