# Grasshopper definition Groundhog - Keio University Roof Garden.ghx (Grasshopper 1.0.4)
# plug-ins: Groundhog

# ---- group: Use bounds and paver size to create grid dimensions
number_slider = Slider(500, range=0..1000)
size_y = Slider(500, range=0..1000)

# ----
simulated_time = Integer(Slider(5, range=0..10))
# Groundhog Project File
# Definition prepared for Groundhog v0.6.1a and depends on components from that plugin. It is available for download at http://groundhog.la/
# 
# Contact groundhog@philipbelesky.com for support or feedback
# 
# This definition is hosted, along with reference materials, at http://groundhog.la/projects/keio-university-roof-garden
# 
# This definition is licensed under the terms of the GPL v3 https://opensource.org/licenses/GPL-3.0
# 
# After creating this I realised the generative landscapes page had also done a tutorial on this project, checkout this link for their approach: https://generativelandscapes.wordpress.com/2014/11/17/keio-university-roof-garden-michel-desvigne-case-study-02/
bounds_for_geometry = Curve(<curve referenced from the Rhino model>)
create_grid = CreateGrid(C=bounds_for_geometry, sx=number_slider, sy=size_y)  # -> C_2, x_2, y_2

# ---- group: Create random slabs
series = Series(Start=0, Step=1, Count=create_grid.y_2)
series_2 = Series(Start=0, Step=1, Count=create_grid.x_2)
remap = RemapNumbers(Value=series_2, Source=create_grid.x_2, Target=Domain(0, 1))  # -> Mapped, Clipped
remap_2 = RemapNumbers(Value=series, Source=create_grid.y_2, Target=Domain(0, 1))  # -> Mapped, Clipped
slab_1_circumference = Slider(375, range=0..1000)
slab_3_circumference = Slider(200, range=0..1000)
slab_5 = Slider(0, range=0..100)
slab_2_circumference = Slider(300, range=0..1000)
slab_4_circumference = Slider(150, range=0..1000)
pt = ConstructPoint(XCoordinate=graft(remap.Mapped), YCoordinate=remap_2.Mapped, ZCoordinate=0)  # -> flatten(Point)
image = ImageSampler(
    pt,
    FilePath="/Users/philip/Sites/groundhog/projects/keio-university-roof-garden/Keio Billboard.png",
    Filter="Value",
    Interpolate=True,
    Umax=1,
    Umin=0,
    Vmax=1,
    Vmin=0,
    Wrap=1)
lng = ListLength(List=[slab_1_circumference, slab_2_circumference, slab_3_circumference, slab_4_circumference, slab_5])
subtraction = Subtraction(A=lng, B=1)
remap_3 = RemapNumbers(Value=image, Source=Domain(0, 1), Target=subtraction)  # -> Mapped, Clipped
round = Round(Number=remap_3.Mapped)  # -> Nearest, Floor, Ceiling
p_n_c = PickNChoose(
    Pattern=graft(round.Nearest),
    Stream0=slab_5,
    Stream1=slab_4_circumference,
    Stream2=slab_3_circumference,
    Stream3=slab_2_circumference,
    Stream4=slab_1_circumference)  # -> flatten(Result)
division = Division(A=p_n_c, B=2)
tile_radii = Integer(division)

# ---- group: Get Cell centers (faster than by using area)
cells = Curve(create_grid.C_2)
curvepoint = PointOnCurve(cells, parameter=0.5)
curvepoint_2 = PointOnCurve(cells, parameter=0)
vec2pt = Vector2Pt(PointA=curvepoint_2, PointB=curvepoint, Unitize=False)  # -> Vector, Length
multiplication = Multiplication(A=vec2pt.Vector, B=0.5)
move = Move(Geometry=curvepoint_2, Motion=multiplication)  # -> Geometry, Transform

# ---- group: Cull cells outside bounds
bounds = Curve(bounds_for_geometry)
centers = Point(move.Geometry)
cells_2 = Curve(create_grid.C_2)
incurve = PointInCurve(Point=centers, Curve=bounds)  # -> Relationship, Point
equals = Equality(FirstNumber=incurve.Relationship, SecondNumber=2)  # -> Equality, Inequality
cull = CullPattern(List=cells_2, CullPattern=equals.Equality)
cull_2 = CullPattern(List=centers, CullPattern=equals.Equality)
cull_3 = CullPattern(List=tile_radii, CullPattern=equals.Equality)
cells_3 = Rectangle(cull)
centers_2 = Point(cull_2)
tile_radii_2 = Integer(cull_3)

# ---- group: Create slab width
cells_4 = Curve(graft(cells_3))
centers_3 = Point(centers_2)
tile_radii_3 = Integer(cull_3)
equals_2 = Equality(FirstNumber=tile_radii_2, SecondNumber=0)  # -> Equality, Inequality
cull_4 = CullPattern(List=centers_3, CullPattern=equals_2.Inequality)
cull_5 = CullPattern(List=tile_radii_2, CullPattern=equals_2.Inequality)
larger = LargerThan(FirstNumber=tile_radii_3, SecondNumber=0)  # -> LargerThan, OrEqualTo
circle = CircleCNR(Center=cull_4, Normal=Vector(0, 0, 1), Radius=cull_5)  # -> graft(Circle)
cull_6 = CullPattern(List=centers_3, CullPattern=larger.LargerThan)
centers_with_gaps = Point(cull_6)
tile_radii_4 = Integer(tile_radii_3)
preview = CustomPreview(Geometry=[circle, cells_4], Shader=ColourSwatch(SwatchColor=RGB(74, 74, 74)))

# ---- group: Make 3D Surface + Extrude (disabled for speed)
slab_thickness = Slider(75, range=0..100)  # disabled
boundary = BoundarySurfaces(Edges=[cells_4, circle])  # disabled
Z = UnitZ(Factor=slab_thickness)  # disabled

# ---- group: Apportion planting type
of_trees = Slider(0.11, range=0..1)
centers_4 = Point(centers_with_gaps)
lng_2 = ListLength(List=centers_4)
random = Random(Range=Domain(0, 1), Number=lng_2, Seed=2)
larger_2 = LargerThan(FirstNumber=of_trees, SecondNumber=random)  # -> LargerThan, OrEqualTo
smaller = SmallerThan(FirstNumber=of_trees, SecondNumber=random)  # -> SmallerThan, OrEqualTo

# ---- group: Tree Planting
centers_5 = Point(centers_with_gaps)
generic_species = GenericSpeciesAttributes()  # -> Shrub, Grass, Tree
lng_3 = ListLength(List=centers_5)
repeat = RepeatData(Data=generic_species.Tree, Length=lng_3)
cull_7 = CullPattern(List=repeat, CullPattern=larger_2.LargerThan)
cull_8 = CullPattern(List=centers_5, CullPattern=larger_2.LargerThan)
shower = PlantAppearanceSimulator(Plants=cull_7, Locations=cull_8, Times=simulated_time)  # -> Trunk, Root, Crown, Spacing, Color, Label
preview_2 = CustomPreview(Geometry=shower.Trunk, Shader=shower.Color)
preview_3 = CustomPreview(Geometry=shower.Crown, Shader=shower.Color)

# ---- group: Grass Planting
centers_6 = Point(centers_with_gaps)
generic_species_2 = GenericSpeciesAttributes()  # -> Shrub, Grass, Tree
lng_4 = ListLength(List=centers_6)
repeat_2 = RepeatData(Data=generic_species_2.Grass, Length=lng_4)
cull_9 = CullPattern(List=centers_6, CullPattern=smaller.SmallerThan)
cull_10 = CullPattern(List=repeat_2, CullPattern=smaller.SmallerThan)
shower_2 = PlantAppearanceSimulator(Plants=cull_10, Locations=cull_9, Times=simulated_time)  # -> Trunk, Root, Crown, Spacing, Color, Label
preview_4 = CustomPreview(Geometry=shower_2.Crown, Shader=shower_2.Color)
preview_5 = CustomPreview(Geometry=shower_2.Trunk, Shader=shower_2.Color)

# ==== cluster CreateGrid
C = ClusterInput()
sx = ClusterInput()
sy = ClusterInput()

# ---- group: Create bounds around roof
explode = Explode(Curve=C, Recursive=True)  # -> Segments, Vertices
bnd = Bounds2D(Coordinates=explode.Vertices)
dedom2num = DeconstructDomain²(Domain=bnd)  # -> UMin, UMax, VMin, VMax
pt = ConstructPoint(XCoordinate=dedom2num.UMin, YCoordinate=dedom2num.VMin, ZCoordinate=0)

# ----
subtraction = Subtraction(A=dedom2num.UMax, B=dedom2num.UMin)
subtraction_2 = Subtraction(A=dedom2num.VMax, B=dedom2num.VMin)
division = Division(A=subtraction, B=sx)
division_2 = Division(A=subtraction_2, B=sy)
recgrid = Rectangular(Plane=pt, SizeX=sx, SizeY=sy, ExtentX=division, ExtentY=division_2)  # -> flatten(Cells), Points
y = Integer(division_2)
x = Integer(division)
C_2 = ClusterOutput(recgrid.Cells)
x_2 = ClusterOutput(x)
y_2 = ClusterOutput(y)
