# Grasshopper definition Groundhog - Max IV Laboratory.ghx (Grasshopper 1.0.4)

# Groundhog Project File
# Definition prepared for Groundhog v0.6.1a and depends on components from that plugin. It is available for download at http://groundhog.la/
# 
# Contact groundhog@philipbelesky.com for support or feedback
# 
# This definition is hosted, along with reference materials, at http://127.0.0.1:4000/projects/max-iv-laboratory
# 
# This definition is licensed under the terms of the GPL v3 https://opensource.org/licenses/GPL-3.0
center_point = Point(<point referenced from the Rhino model>)
circle = CircleCNR(Center=center_point, Normal=Vector(0, 0, 1), Radius=Slider(110000, range=0..1000000))

# ---- group: Curved Segments
curve_length = Slider(10, range=0..100)
curve_points = Slider(20, range=0..100)
dom = ConstructDomain(DomainStart=0, DomainEnd=curve_length)
divide = DivideCurve(Curve=circle, Count=Slider(32, range=0..100), Kinks=False)  # -> Points, Tangents, Parameters
range = Range(Domain=dom, Steps=curve_points)
graph = GraphMapper(
    range,
    x0=0,
    x1=10,
    y0=0,
    y1=2,
    container_name="Bezier",
    cpx=[0, 0.1810597032, 0.5611973405, 1],
    cpy=[0, 0.8286336064, 0.8465806842, 0.5773736835])
multiplication = Multiplication(A=graph, B=-1)
origin = Point(graft(divide.Points))
vec = Vector(graft(divide.Tangents))
vec_2 = VectorXYZ(XComponent=range, YComponent=multiplication, ZComponent=0)  # -> Vector, Length
scaling = Slider(46241, range=0..100000)
xy = XYPlane(Origin=origin)
align = AlignPlane(Plane=xy, Direction=vec)  # -> Plane, Angle
multiplication_2 = Multiplication(A=vec_2.Vector, B=scaling)
move = Move(Geometry=origin, Motion=multiplication_2)  # -> Geometry, Transform
subtraction = Subtraction(A=align.Angle, B=Slider(5.8, range=0..10))
intcrv = Interpolate(Vertices=move.Geometry, Degree=3, Periodic=False, KnotStyle=1)  # -> Curve, Length, Domain
rotate = Rotate(Geometry=intcrv.Curve, Angle=subtraction, Plane=align.Plane)  # -> Geometry, Transform

# ---- group: Straight tangents
xy_2 = XYPlane(Origin=Point(0, 0, 0))
divide_2 = DivideCurve(Curve=circle, Count=Slider(40, range=0..100), Kinks=False)  # -> Points, Tangents, Parameters
rad = Radians(Degrees=Slider(194, range=0..360))
vrot = Rotate(Vector=divide_2.Tangents, Axis=xy_2, Angle=rad)
multiplication_3 = Multiplication(A=vrot, B=Slider(400000, range=100000..400000))
move_2 = Move(Geometry=divide_2.Points, Motion=multiplication_3)  # -> Geometry, Transform
ln = Line(StartPoint=divide_2.Points, EndPoint=move_2.Geometry)

# ---- group: Trim to Boundary
site_bounds = Curve(<curve referenced from the Rhino model>)
straight_tangents = Curve(ln)
curved_tangents = Curve(rotate.Geometry)
ccx = CurveCurve(CurveA=site_bounds, CurveB=straight_tangents)  # -> Points, ParamsA, ParamsB
ccx_2 = CurveCurve(CurveA=site_bounds, CurveB=curved_tangents)  # -> Points, ParamsA, ParamsB
subcrv = SubCurve(BaseCurve=graft(straight_tangents), Domain=ccx.ParamsB)
subcrv_2 = SubCurve(BaseCurve=graft(curved_tangents), Domain=ccx_2.ParamsB)
curved_tangents_2 = Curve(subcrv_2)
straight_tangents_2 = Curve(subcrv)

# ----
number_slider = Slider(22, range=0..100)
divide_3 = DivideCurve(Curve=straight_tangents_2, Count=number_slider, Kinks=False)  # -> Points, Tangents, Parameters
pdecon = Deconstruct(Point=divide_3.Points)  # -> XComponent, YComponent, ZComponent
repeat = RepeatData(Data=[Slider(0, range=0..1000), Slider(4500, range=0..10000)], Length=number_slider)
pt = ConstructPoint(XCoordinate=pdecon.XComponent, YCoordinate=pdecon.YComponent, ZCoordinate=repeat)
# This part of the definition is still to be completed. The different tangent curves need to be assembled into a surface and then draining simulations and planting distribution performed. Kangaroo-based simulations of the acoustic spread may also be added.
nurbs = NurbsCurve(Vertices=pt, Degree=3, Periodic=False)  # -> Curve, Length, Domain

number_slider_2 = Slider(22, range=0..100)
divide_4 = DivideCurve(Curve=curved_tangents_2, Count=number_slider_2, Kinks=False)  # -> Points, Tangents, Parameters
pdecon_2 = Deconstruct(Point=divide_4.Points)  # -> XComponent, YComponent, ZComponent
repeat_2 = RepeatData(Data=[Slider(0, range=0..1000), Slider(4500, range=0..10000)], Length=number_slider_2)
pt_2 = ConstructPoint(XCoordinate=pdecon_2.XComponent, YCoordinate=pdecon_2.YComponent, ZCoordinate=repeat_2)
nurbs_2 = NurbsCurve(Vertices=pt_2, Degree=3, Periodic=False)  # -> Curve, Length, Domain
